vi "80 MHz VHT Subcarrier.gvi"   [LabVIEW NXG 2.1.0]
inputs:
  "Array": u64[]
outputs:
  "subarray": u64[]
diagram:
  w1 = -122  # smallest frequency offset index
  w2 = 128  # FFT center
  # based on VHT 80 MHz
  Add(w2, w1) -> w3
  w4 = 245  # total number of subcarriers
  Array Subset(array=$Array, index0=w3, length0=w4) -> w5
  $subarray <- w5
