vi "802.11 Prepare Channel Estimation ac.gvi"   [LabVIEW NXG 2.1.0]
# Reads the channel estimation direct memory access (DMA) FIFO and computes the channel estimation magnitude and phase. The DMA FIFO contains the channel estimates from legacy long training field (L-LTF) and very high throughput long training field (VHT-LTF).
inputs:
  "FPGA interface": "802.11 FGPA Reference.gtype"  # Interface to the device's FPGA handle.
  "error in": error
  "Primary Channel Selector": UFXP(2.0) = 1  # Numeric control to determine which subband is used as the primary channel. The PHY covers 80 MHz bandwidth, which can be divided into four subbands {0,…,3} of 20 MHz bandwidth for the non-high throughput (non-HT) signal. For wider bandwidths the subbands get combined. Visit ni.com/info and enter the Info Code 80211AppFWManual to access the LabVIEW Communications 802.11 Application Framework Manual for more information about channelization.
outputs:
  "error out": error
  "update power spectrum": bool  # Determines whether the channel estimation array contains valid information.
panel controls:
  "Raw Array": c128[][]
  "number": i32 = 1000
  "threshold min": f64 = 0.01
  "threshold max": f64 = 0.01
  "Take Measurements": bool = TRUE
panel indicators:
  "Phase Out": f64[][]
  "Graph": f64[]
  "Graph_2": f64[]
  "Amplitude Out": f64[][]
  "Measured Fingerprints": f64[][]
diagram:
  Host Fifo Read Node[FifoName="802.11 AFW Resources.grsc\\T2H Channel Estimation"](error in=$"error in", number of elements=0, reference in=$"FPGA interface", timeout (ms)=-1) -> (elements remaining=w1, error out=w2, reference out=w3)
  Quotient And Remainder(x=w1, y=256) -> (floor(x/y)=w4, x-y*floor(x/y)=w5)
  Is Greater Than 0(x=w5) -> w6
  # Eror control: Read from FIFO if less than 256 values
  case (w6) {
    frame False, Default { }
    frame True {
      Host Fifo Read Node[FifoName="802.11 AFW Resources.grsc\\T2H Channel Estimation"](number of elements=w5, reference in=$"FPGA interface", timeout (ms)=-1)
    }
  }
  Is Greater Than 0(x=w4) -> w7
  $"update power spectrum" <- w7
  To Long Integer(number=256) -> w8
  Multiply(w4, 256) -> w9
  Host Fifo Read Node[FifoName="802.11 AFW Resources.grsc\\T2H Channel Estimation"](error in=w2, number of elements=w9, reference in=w3, timeout (ms)=-1) -> (data=w10, error out=w11)
  case (w7) {
    frame False, Default { }
    frame True {
      # increase chance to get a VHT-LTF
      Array Size(array=w10) -> (size(s)=w12)
      Quotient And Remainder(x=w12, y=256) -> (floor(x/y)=w13)
      for (N = w13) (iteration -> i1) {
        Multiply(256, i1) -> w14
        # Filter for used subcarriers
        Array Subset(array=w10, index0=w14, length0=256) -> w15
        call "80 MHz VHT Subcarrier.gvi"(Array=w15) -> (subarray=w16)
        call "Get 20MHz SCs UInt64.gvi"(Delete DC=TRUE, subarray=w16, Primary Channel Selector=$"Primary Channel Selector") -> (SCs=w17)
        Split Number(x=w17) -> (high(x)=w18, low(x)=w19)
        To Long Integer(number=w18) -> w20
        Reinterpret Number[RestrictToSameWordLength=True](data in=w20, type=FXP(11.21) 0) -> (data out=w21)
        To Long Integer(number=w19) -> w22
        Reinterpret Number[RestrictToSameWordLength=True](data in=w22, type=FXP(11.21) 0) -> (data out=w23)
        Real And Imaginary To Complex(x=w23, y=w21) -> w24
        To Double Precision Complex(number=w24) -> w25
        Complex To Polar(r * e^(i*theta)=w25) -> (r=w26, theta=w27)
        # Filter only valid frames
        call "VHT CSI min.gvi"(amplitude in=w26, threshold=$"threshold min") -> (VHT sample=w28)
        call "VHT CSI max.gvi"(amplitude in=w26, threshold=$"threshold max") -> (VHT sample=w29)
        Logical And(w28, w29, $"Take Measurements") -> w30
        # extract fingerprints from channel measurement
        case (w30) {
          frame False, Default {
            call "RT ident of Rogue 802.11a.gvi"(Phase in=w27)
          }
          frame True {
            call "Insert Into Array Front Complex.gvi"(Raw Array=$"Raw Array", Array=w25, number=$number) -> (Raw Array out=w31)
            $"Raw Array" <- w31
            call "Insert Into Array Front.gvi"(Raw Array in=$"Amplitude Out", Array=w26, number=$number) -> (Raw Array out=w32)
            $"Amplitude Out" <- w32
            call "RT ident of Rogue 802.11ac.gvi"(Phase in=w27, Take Measurements=w30) -> (Measured Fingerprints=w33)
            $"Measured Fingerprints" <- w33
            call "Insert Into Array Front.gvi"(Raw Array in=$"Phase Out", Array=w27, number=$number) -> (Raw Array out=w34)
            $"Phase Out" <- w34
            $Graph <- w27
          }
        }
        $Graph_2 <- w26
      }
    }
  }
  $"error out" <- w11
