vi "Apply Gradient Change.gvi"   [LabVIEW NXG 2.1.0]
inputs:
  "array": f64[]
  "gradient change": i32
  "index": i32
outputs:
  "output array": f64[]
diagram:
  Delete From Array(inArray=$array, index0=$index) -> w1
  Array Index(array=$array) -> (out0[$index]=w2)
  Negate(x=$"gradient change") -> w3
  Multiply(w3, f64 default) -> w4
  Add(w2, w4) -> w5
  Insert Into Array(inArray=w1, index0=$index, new=w5) -> w6
  $"output array" <- w6
