vi "Check Against Known Fingerprint.gvi"   [LabVIEW NXG 2.1.0]
inputs:
  "Merged Phases": f64[]
  "Fingerprint Ground Truth": f32[][] = [[0, -0.0628, -0.1147, -0.1554, -0.1888, -0.2104, -0.2271, -0.2406, -0.2436, -0.249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]]
outputs:
  "Fingerprint derivation": f64[]
  "Fingerprint derivation sum": f64
  "Fingerprint Ground Truth out": f32[]
diagram:
  Transpose 2D Array(2D array=$"Fingerprint Ground Truth") -> (transposed array=w1)
  Array Index(array=w1) -> (out0[_, 0]=w2)
  Subtract(x=w2, y=$"Merged Phases") -> w3
  $"Fingerprint derivation" <- w3
  Add Array Elements(numeric array=w3) -> (sum=w4)
  $"Fingerprint derivation sum" <- w4
  $"Fingerprint Ground Truth out" <- w2
