vi "Convert Uint Array to Uint.gvi"   [LabVIEW Communications System Design Suite 2.0.1]
inputs:
  "remaining elements": cluster{"Element 0": u8[]}[]
outputs:
  "Array": u32[]
  "number_2": u32
diagram:
  Array Index(array=$"remaining elements") -> (out0[_]=w1)
  # extract randomization index
  Property Node(instance in=w1) -> ("Element 0"=w2)
  Array Subset(array=w2, index0=0, length0=4) -> w3
  To Unsigned Long Integer(number=w3) -> w4
  $Array <- w4
  Array Index(array=w3) -> (out0[0]=w5)
  Number To Boolean Array(number=w5) -> (Boolean array=w6)
  Reverse 1D Array(array=w6) -> (reversed array=w7)
  Array Index(array=w3) -> (out0[1]=w8)
  Number To Boolean Array(number=w8) -> (Boolean array=w9)
  Reverse 1D Array(array=w9) -> (reversed array=w10)
  Array Index(array=w3) -> (out0[2]=w11)
  Number To Boolean Array(number=w11) -> (Boolean array=w12)
  Reverse 1D Array(array=w12) -> (reversed array=w13)
  Array Index(array=w3) -> (out0[3]=w14)
  Number To Boolean Array(number=w14) -> (Boolean array=w15)
  Reverse 1D Array(array=w15) -> (reversed array=w16)
  Build Array[ConcatenateInputs=True](w7, w10, w13, w16) -> w17
  Reverse 1D Array(array=w17) -> (reversed array=w18)
  Boolean Array To Number(Boolean array=w18) -> (number=w19)
  $number_2 <- w19
