vi "Determine Pattern.gvi"   [LabVIEW NXG 2.1.0]
inputs:
  "MAC seq num send": UFXP(12.0)
outputs:
  "output_2": T1
types:
  T1 = enum{"pattern_1", "pattern_2", "pattern_3", "pattern_4"}
diagram:
  To Unsigned Long Integer(number=$"MAC seq num send") -> w1
  Quotient And Remainder(x=w1, y=1024) -> (x-y*floor(x/y)=w2)
  Is Greater(x=w2, y=768) -> w3
  # select a new pattern after 256 frames. This needs to be increased to per-frame basis. More patterns would be needed
  Is Less(x=w2, y=768) -> w4
  Is Greater(x=w2, y=512) -> w5
  Logical And(w4, w5) -> w6
  Is Less(x=w2, y=512) -> w7
  Is Greater(x=w2, y=256) -> w8
  Logical And(w7, w8) -> w9
  Select(s=w9, t="pattern_2", f="pattern_1") -> w10
  Select(s=w6, t="pattern_3", f=w10) -> w11
  Select(s=w3, t="pattern_4", f=w11) -> w12
  $output_2 <- w12
