vi "Get 20MHz SCs.gvi"   [LabVIEW NXG 2.1.0]
inputs:
  "Delete DC": bool
  "array": f64[]
  "Primary Channel Selector": UFXP(2.0) = 1  # Numeric control to determine which subband is used as the primary channel. The PHY covers 80 MHz bandwidth, which can be divided into four subbands {0,…,3} of 20 MHz bandwidth for the non-high throughput (non-HT) signal. For wider bandwidths the subbands get combined. Visit ni.com/info and enter the Info Code 80211AppFWManual to access the LabVIEW Communications 802.11 Application Framework Manual for more information about channelization.
outputs:
  "SCs": f64[]
diagram:
  To Byte Integer(number=$"Primary Channel Selector") -> w1
  case (w1) {
    frame 0, Default {
      w2 = 0
    }
    frame 1 {
      w2 = 61
    }
    frame 2 {
      # 126
      w2 = 126
    }
    frame 3 {
      w2 = 192
    }
  }
  Array Subset(array=$array, index0=w2, length0=57) -> w3
  case ($"Delete DC") {
    frame False, Default {
      w4 = w3
    }
    frame True {
      Delete From Array(inArray=w3, index0=28) -> w4
    }
  }
  $SCs <- w4
