vi "Insert Into Array Front Complex.gvi"   [LabVIEW NXG 2.1.0]
inputs:
  "Raw Array": c128[][]
  "Array": c128[]
  "number": i32 = 1000
outputs:
  "Raw Array out": c128[][]
diagram:
  Insert Into Array(inArray=$"Raw Array", index0=0, new=$Array) -> w1
  Array Size(array=w1) -> (size(s)=w2)
  Array Index(array=w2) -> (out0[0]=w3)
  Is Greater(x=w3, y=$number) -> w4
  case (w4) {
    frame False, Default {
      w5 = w1
    }
    frame True {
      Delete From Array(inArray=w1, index0=$number) -> w5
    }
  }
  $"Raw Array out" <- w5
