vi "Insert Into Array Front.gvi"   [LabVIEW NXG 2.1.0]
inputs:
  "Raw Array in": f64[][]  # Graphical indication shows the TX packet error rate and TX block error rate. The TX packet error rate is calculated as a ratio of successful MPDU transmitted to the number of transmission tries. The TX block error rate is calculated as a ratio of successful MPDU transmitted to the total number of transmission. The most recent values are displayed on the upper right of the graph.
  "Array": f64[]
  "number": i32 = 1000
outputs:
  "Raw Array out": f64[][]
diagram:
  Insert Into Array(inArray=$"Raw Array in", index0=0, new=$Array) -> w1
  Array Size(array=w1) -> (size(s)=w2)
  Array Index(array=w2) -> (out0[0]=w3)
  Is Greater(x=w3, y=$number) -> w4
  case (w4) {
    frame False, Default {
      w5 = w1
    }
    frame True {
      Delete From Array(inArray=w1, index0=$number) -> w5
    }
  }
  $"Raw Array out" <- w5
