vi "Normalize Phases.gvi"   [LabVIEW NXG 2.1.0]
inputs:
  "Phase unwrapped": f64[]
outputs:
  "Phase unwrapped and normalized": f64[]
diagram:
  # -1
  # +1
  Array Index(array=$"Phase unwrapped") -> (out0[25]=w1)
  Subtract(x=$"Phase unwrapped", y=w1) -> w2
  Array Index(array=$"Phase unwrapped") -> (out0[26]=w3)
  Subtract(x=w1, y=w3) -> w4
  Divide(x=w4, y=2) -> w5
  Add(w2, w5) -> w6
  $"Phase unwrapped and normalized" <- w6
