vi "RT ident of Rogue 802.11ac.gvi"   [LabVIEW NXG 2.1.0]
# Calculates the RF signal power on primary and secondary channels. Compares the RF signal power against CCA energy threshold and generated CCA indication based on energy detection.
# Latency: min 10 clock cycles
inputs:
  "Phase in": f64[]
  "Take Measurements": bool
outputs:
  "Phase Gradients": f64[]
  "Phase unwrapped": f64[]
  "Valid": bool
  "Merged Phases": f64[]
  "Measured Fingerprints": f64[][]
panel controls:
  "Measurement Ammount": i32 = 100
panel indicators:
  "Unmodified Phase": f64[]
  "Fingerprint derivation sum": f64
  "Fingerprint derivation": f64[]
  "Graph": f64[][]
  "Measured Phases Unwrapped": f64[][]
  "error out": error
uses:
  NI::Analysis::LinearAlgebra::A x Vector.gvi
diagram:
  # Extract Phase Gradients
  Array Size(array=$"Phase in") -> (size(s)=w1)
  w2 = [[-1, 1, 0, 0, 0, 0, 0, 0, 0, 0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], [0, -1, 1, 0, 0, 0, 0, 0, 0, 0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], [0, 0, -1, 1, 0, 0, 0, 0, 0, 0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], [0, 0, 0, -1, 1, 0, 0, 0, 0, 0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], [0, 0, 0, 0, -1, 1, 0, 0, 0, 0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], [0, 0, 0, 0, 0, -1, 1, 0, 0, 0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], [0, 0, 0, 0, 0, 0, -1, 1, 0, 0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], [0, 0, 0, 0, 0, 0, 0, -1, 1, 0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], [0, 0, 0, 0, 0, 0, 0, 0, -1, 1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], [0, 0, 0, 0, 0, 0, 0, 0, 0, -1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]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]
  call "A x Vector.gvi"(Matrix A=w2, Vektor v=$"Phase in") -> (A x v=w3, Fehler (Ausgang)=w4)
  # Check if measurement is valid
  #
  # ==> Exclude Measurements where phase jumps more than pi but less then 2 pi
  s1 = 0  # shift register
  s2 = $"Phase in"  # shift register
  for (N = w1) (iteration -> i1) {
    w5 = each element of w3
    call "Apply Gradient Change.gvi"(array=s2, gradient change=s1, index=i1) -> (output array=w6)
    Absolute Value(x=w5) -> w7
    Is Greater(x=w7, y=4) -> w8
    case (w8) {
      frame False {
        Is Greater(x=w5, y=1.2) -> w10
        case (w10) {
          frame False, Default {
            Negate(x=1.2) -> w11
            Is Less(x=w5, y=w11) -> w12
            case (w12) {
              frame False, Default {
                w9 = s1
              }
              frame True {
                Decrement(x=s1) -> w9
              }
            }
          }
          frame True {
            # shifted by 2 pi
            Increment(x=s1) -> w9
          }
        }
      }
      frame True {
        Is Greater(x=w5, y=4) -> w13
        case (w13) {
          frame False, Default {
            Negate(x=4) -> w14
            Is Less(x=w5, y=w14) -> w15
            case (w15) {
              frame False, Default {
                w9 = s1
              }
              frame True {
                Subtract(x=s1, y=2) -> w9
              }
            }
          }
          frame True {
            # shifted by 2 pi
            Add(2, s1) -> w9
          }
        }
      }
    }
    next s1 = w9
    next s2 = w6
    stop if FALSE
  }
  Not(x=FALSE) -> w16
  $Valid <- w16
  # Valid phases normalized
  call "Apply Gradient Change.gvi"(array=s2, gradient change=s1, index=55) -> (output array=w17)
  Array Index(array=w17) -> (out0[27]=w18)
  # -28
  # -1
  Array Index(array=w17) -> (out0[28]=w19)
  Add(w18, w19) -> w20
  Divide(x=w20, y=2) -> w21
  Array Index(array=w17) -> (out0[55]=w22)
  # +1
  # 28
  Array Index(array=w17) -> (out0[0]=w23)
  Negate(x=w23) -> w24
  Add(w24, w22) -> w25
  Multiply(56, f64 default) -> w26
  # lambda
  Divide(x=w25, y=w26) -> w27
  w28 = [-28, -27, -26, -25, -24, -23, -22, -21, -20, -19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]
  # Compensate for the last index
  # Z*
  # Z*
  case (w16) {
    frame False, Default {
      w29 = w17
    }
    frame True {
      Multiply(w27, f64 default) -> w30
      Multiply(w28, w30) -> w31
      Add(w21, w31) -> w32
      Subtract(x=w17, y=w32) -> w29
    }
  }
  Logical And($"Take Measurements", w16) -> w33
  case (w33) {
    frame False, Default {
      w34 = f64[][] []
    }
    frame True {
      Delete From Array(inArray=$"Measured Phases Unwrapped", index0=$"Measurement Ammount") -> w35
      Insert Into Array(inArray=w35, index0=0, new=$"Phase in") -> w36
      $"Measured Phases Unwrapped" <- w36
      Delete From Array(inArray=$"Measured Fingerprints", index0=$"Measurement Ammount") -> w37
      Insert Into Array(inArray=w37, index0=0, new=w29) -> w34
    }
  }
  $"Measured Fingerprints" <- w34
  Subtract(x=w17, y=w21) -> w38
  $"Phase unwrapped" <- w38
  w39 = [[0, -0.1022, -0.1769, -0.2387, -0.2892, -0.3249, -0.3466, -0.3676, -0.3765, -0.3841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]]
  call "Check Against Known Fingerprint.gvi"(Merged Phases=w29, Fingerprint Ground Truth=w39) -> (Fingerprint derivation=w40, Fingerprint derivation sum=w41, Fingerprint Ground Truth out=w42)
  $"Fingerprint derivation" <- w40
  $"Merged Phases" <- w29
  $"Fingerprint derivation sum" <- w41
  $"Unmodified Phase" <- $"Phase in"
  w43 = [[0, -0.0015, -0.0038, -0.0051, -0.0043, -0.0052, -0.0066, -0.0067, -0.0083, -0.0072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]]
  Transpose 2D Array(2D array=w43) -> (transposed array=w44)
  Array Index(array=w44) -> (out0[_, 0]=w45)
  Build Array(w42, w29, w45) -> w46
  $Graph <- w46
  $"Phase Gradients" <- w3
  $"error out" <- w4
