vi "Remove Subcarriers.gvi"   [LabVIEW NXG 2.1.0]
inputs:
  "double precision complex": c128[]
outputs:
  "array with subset deleted": c128[]
diagram:
  Delete From Array(inArray=$"double precision complex", length (1)=2, index0=54) -> w1
  Delete From Array(inArray=w1, length (1)=2, index0=0) -> w2
  $"array with subset deleted" <- w2
