vi "Secure Fingerprinting Receiver.gvi"   [LabVIEW NXG 2.1.0]
inputs:
  "r": f64[]
  "sequence number": UFXP(12.0)
  "selector": bool
  "randomization index": u32
outputs:
  "x - y": f64[]
diagram:
  To Fixed Point(fixed-point type=$"sequence number", number=$"randomization index") -> w1
  call "Determine Pattern.gvi"(MAC seq num send=w1) -> (output_2=w2)
  # For the PoC, we used 4 patters that swtich according to the MAC sequence number
  case (w2) {
    frame "pattern_1", Default {
      w4 = [0.08687613, 0.005178377, 0.3021507, -0.2138152, -0.1904171, 0.183137, 0.3446534, -0.3339757, 0.166867, -0.3386784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]
      w3 = w4
    }
    frame "pattern_2" {
      w5 = [-0.15477, -0.002371958, -0.002135304, -0.1825618, 0.03259223, -0.1194071, -0.1061964, 0.04430965, 0.09432002, 0.3386223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]
      w3 = w5
    }
    frame "pattern_3" {
      w6 = [0.04008465, 0.2288634, 0.2753425, 0.02980654, 0.06914061, -0.218091, 0.05297923, 0.1022787, 0.1948844, -0.2469404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]
      w3 = w6
    }
    frame "pattern_4" {
      w7 = [-0.1509227, 0.2637008, -0.0001503196, 0.289331, -0.05229901, 0.2840843, 0.00423112, 0.3251136, 0.238733, 0.1041016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]
      w3 = w7
    }
  }
  Array Subset(array=w3, index0=2, length0=53) -> w8
  Delete From Array(inArray=w8, index0=26) -> w9
  Subtract(x=$r, y=w9) -> w10
  Select(s=$selector, t=w10, f=$r) -> w11
  $"x - y" <- w11
