vi "VHT CSI max.gvi"   [LabVIEW NXG 2.1.0]
inputs:
  "amplitude in": f64[]
  "threshold": f64 = 0.01
outputs:
  "VHT sample": bool
diagram:
  Array Index(array=$"amplitude in") -> (out0[55]=w1)
  Is Less(x=w1, y=$threshold) -> w2
  Array Index(array=$"amplitude in") -> (out0[0]=w3)
  # return true if the sample is a VHT sample
  Is Less(x=w3, y=$threshold) -> w4
  Logical And(w4, w2) -> w5
  $"VHT sample" <- w5
