vi "VHT CSI min.gvi"   [LabVIEW NXG 2.1.0]
inputs:
  "amplitude in": f64[]
  "threshold": f64 = 0.01
outputs:
  "VHT sample": bool
diagram:
  # return true if the sample is a VHT sample
  Array Index(array=$"amplitude in") -> (out0[0]=w1)
  Is Greater(x=w1, y=$threshold) -> w2
  Array Index(array=$"amplitude in") -> (out0[55]=w3)
  Is Greater(x=w3, y=$threshold) -> w4
  Logical And(w2, w4) -> w5
  $"VHT sample" <- w5
