vi "Add 2pi to Index.gvi"   [LabVIEW NXG 2.1.0]
inputs:
  "array": f64[]
  "index": i32 = 51
outputs:
  "output array": f64[]
diagram:
  Delete From Array(inArray=$array, index0=$index) -> w1
  Array Index(array=$array) -> (out0[$index]=w2)
  Subtract(x=w2, y=f64 default) -> w3
  Insert Into Array(inArray=w1, index0=$index, new=w3) -> w4
  $"output array" <- w4
