vi "Add Fingerprint.gvi"   [LabVIEW NXG 2.1.0]
inputs:
  "imaginary in": CFXP(2.14)
  "seemoo index in": i32
  "sample": f64
  "index": i32
  "Compensate own fingerprint": bool
  "Add Fake Fingerprint": bool
  "write seemoo image": bool
  "randomize fingerprint": bool
outputs:
  "z": CFXP(2.14)
uses:
  NI::Analysis::Generation::Triangle Wave.gvi
  NI::Analysis::Generation::Gaussian White Noise.gvi
diagram:
  Complex To Polar(r * e^(i*theta)=$"imaginary in") -> (r=w1, theta=w2)
  call "Get Seemoo Pixel.gvi"(row index=$index, column index=$"seemoo index in") -> (subarray=w3)
  case ($"Compensate own fingerprint") {
    frame False, Default {
      w4 = w2
    }
    frame True {
      w5 = [[-0.0993, -0.0951, -0.0921, -0.0878, -0.0822, -0.0784, -0.0757, -0.0698, -0.0676, -0.0613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]]
      # Own fingerprint from loopback
      call "Add Null and DC.gvi"(2D array=w5) -> (output array=w6)
      Array Index(array=w6) -> (out0[$index]=w7)
      To Fixed Point(number=w7) -> w8: FXP(3.13) Saturate:ConvergentRounding
      Subtract(x=w2, y=w8) -> w4: FXP(3.13) Saturate:ConvergentRounding
    }
  }
  To Fixed Point(number=$sample) -> w9: FXP(2.14) Saturate:ConvergentRounding
  case ($"Add Fake Fingerprint") {
    frame False, Default {
      w10 = w4
    }
    frame True {
      Add(w4, w9) -> w10: FXP(3.13) Saturate:ConvergentRounding
    }
  }
  case ($"write seemoo image") {
    frame False, Default {
      w11 = w10
    }
    frame True {
      Add(w10, w3) -> w11: FXP(3.13) Saturate:ConvergentRounding
    }
  }
  call "Triangle Wave.gvi"(Sample-Rate=1, Samples=57, Amplitude=0.6, Frequenz=0.0078125, Phase zurücksetzen=TRUE) -> (Dreieckschwingung=w12)
  case ($"randomize fingerprint") {
    frame False, Default {
      w13 = w11
    }
    frame True {
      Square Root(x=1) -> w14
      call "Gaussian White Noise.gvi"(Samples=1, Standardabweichung=w14) -> (Gaußsches weißes Rauschen=w15)
      Array Index(array=w15) -> (out0[0]=w16)
      To Fixed Point(number=w16)
      # normal distribution
      Square Root(x=3) -> w17
      Array Index(array=w12) -> (out0[$index]=w18)
      Random Number() -> (number (0 to 1)=w19)
      Subtract(x=w19, y=w18) -> w20
      Multiply(w17, w20) -> w21
      To Fixed Point(number=w21) -> w22: FXP(3.13) Saturate:ConvergentRounding
      Add(w11, w22) -> w13: FXP(3.13) Saturate:ConvergentRounding
    }
  }
  Polar To Complex(r=w1, theta=w13) -> (r * e^(i*theta)=w23: CFXP(3.13) Saturate:Default)
  $z <- w23
