vi "Add Null and DC.gvi"   [LabVIEW NXG 2.1.0]
inputs:
  "2D array": f32[][]
outputs:
  "output array": f32[57]
diagram:
  Transpose 2D Array(2D array=$"2D array") -> (transposed array=w1)
  Array Index(array=w1) -> (out0[_, 0]=w2)
  Insert Into Array(inArray=w2, index0=0, new=0) -> w3
  Insert Into Array(inArray=w3, index0=0, new=0) -> w4
  Insert Into Array(inArray=w4, new=0) -> w5
  Insert Into Array(inArray=w5, new=0) -> w6
  Insert Into Array(inArray=w6, index0=28, new=0) -> w7
  $"output array" <- w7
