vi "Channel To Byte Array.gvi"   [LabVIEW NXG 2.1.0]
inputs:
  "Channel in": CFXP(2.14)
outputs:
  "data out": u32
diagram:
  Complex To Real Imaginary(x + iy=$"Channel in") -> (x=w1, y=w2)
  Reinterpret Number[RestrictToSameWordLength=True](data in=w2, type=i16 0) -> (data out=w3)
  Reinterpret Number[RestrictToSameWordLength=True](data in=w1, type=i16 0) -> (data out=w4)
  Join Numbers(high(x)=w3, low(x)=w4) -> w5
  $"data out" <- w5
