vi "Convert Complex Array to Unsigned Array.gvi"   [LabVIEW NXG 2.1.0]
# Calculates the RF signal power on primary and secondary channels. Compares the RF signal power against CCA energy threshold and generated CCA indication based on energy detection.
# Latency: min 10 clock cycles
inputs:
  "message complex": CFXP(2.14)[57] = [0+0i, 0+0i, 1+0i, 1+0i, -1+0i, -1+0i, 1+0i, 1+0i, -1+0i, 1+0i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]
  "sequence number": UFXP(12.0)
outputs:
  "Array": u8[114]
panel controls:
  "Remove Own Fingerprint": bool
  "Spoof Fingerprint": bool
  "write seemoo image": bool
  "image duration per pixel": i32
  "randomize fingerprint": bool
  "apply secure fingerprinting": bool
  "seemoo index in": i32
  "actual duration": u32
diagram:
  # Own Measured Fingerprint
  w1 = [[-0.2922, -0.3557, -0.402, -0.4394, -0.467, -0.4854, -0.495, -0.4999, -0.4993, -0.4943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]]
  # Fingerprint to fake
  call "Add Null and DC.gvi"(2D array=w1) -> (output array=w2)
  w3 = [[-0.0993, -0.0951, -0.0921, -0.0878, -0.0822, -0.0784, -0.0757, -0.0698, -0.0676, -0.0613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]]
  call "Add Null and DC.gvi"(2D array=w3) -> (output array=w4)
  w5 = $"Remove Own Fingerprint"
  w6 = $"write seemoo image"
  w7 = $"randomize fingerprint"
  w8 = $"apply secure fingerprinting"
  w9 = $"Spoof Fingerprint"
  w10 = $"seemoo index in"
  # Here we can compensate our own Fingerprint and subsequently fake another Fingerprint that we have recorded
  s1 = 0  # shift register
  s2 = [0, 0, 0, 0, 0, 0, 0, 0, 0, 0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]  # shift register
  for (iteration -> i1) {
    w11 = each element of $"message complex"
    w12 = each element of w2
    w13 = each element of w4
    Complex To Polar(r * e^(i*theta)=w11) -> (r=w14, theta=w15)
    To Fixed Point(number=w13) -> w16: FXP(4.13) Saturate:ConvergentRounding
    To Fixed Point(number=w12) -> w17: FXP(4.13) Saturate:ConvergentRounding
    call "Add Phase.gvi"(theta=w15, theta new=w17, selector=w9) -> (output=w18)
    call "Subtract Phase.gvi"(theta=w18, theta new=w16, selector=w5) -> (output=w19)
    call "Get Seemoo Pixel.gvi"(row index=i1, column index=w10) -> (subarray=w20)
    call "Add Phase.gvi"(theta=w19, theta new=w20, selector=w6) -> (output=w21)
    call "Randomize Fingerprint.gvi"(theta=w21, selector=w7, index=i1) -> (theta out=w22)
    call "Secure Fingerprinting Sender.gvi"(theta in=w22, Boolean=w8, MAC seq num send=$"sequence number", index=i1) -> (output=w23)
    Polar To Real And Imaginary(r=w14, theta=w23) -> (y=w24: FXP(2.14) Saturate:Default, x=w25: FXP(2.14) Saturate:Default)
    Multiply(64, w25) -> w26: FXP(21.14) Saturate:ConvergentRounding
    To Byte Integer(number=w26) -> w27
    Multiply(64, w24) -> w28: FXP(21.14) Saturate:ConvergentRounding
    To Byte Integer(number=w28) -> w29
    Insert Into Array(inArray=s2, index0=s1, new=w29) -> w30
    Increment(x=s1) -> w31
    Insert Into Array(inArray=w30, index0=w31, new=w27) -> w32
    Increment(x=w31) -> w33
    next s1 = w33
    next s2 = w32
  }
  $Array <- s2
  case (w6) {
    frame False, Default {
      w34 = $"actual duration"
      w35 = w10
    }
    frame True {
      Is Equal(x=$"image duration per pixel", y=$"actual duration") -> w36
      case (w36) {
        frame False, Default {
          Increment(x=$"actual duration") -> w34: u32
          w35 = w10
        }
        frame True {
          Increment(x=w10) -> w35
          w34 = 0
        }
      }
    }
  }
  $"actual duration" <- w34
  $"seemoo index in" <- w35
