vi "Convert Int to Uint8 Array.gvi"   [LabVIEW NXG 2.1.0]
inputs:
  "sequence number send": UFXP(12.0)
outputs:
  "appended array": u8[]
diagram:
  To Long Integer(number=$"sequence number send") -> w1
  Number To Boolean Array(number=w1) -> (Boolean array=w2)
  Array Subset(array=w2, index0=0, length0=8) -> w3
  Boolean Array To Number(Boolean array=w3) -> (number=w4: u8)
  Array Subset(array=w2, index0=8, length0=8) -> w5
  Boolean Array To Number(Boolean array=w5) -> (number=w6: u8)
  Array Subset(array=w2, index0=16, length0=8) -> w7
  Boolean Array To Number(Boolean array=w7) -> (number=w8: u8)
  Array Subset(array=w2, index0=24, length0=8) -> w9
  Boolean Array To Number(Boolean array=w9) -> (number=w10: u8)
  Build Array(w4, w6, w8, w10) -> w11
  Reverse 1D Array(array=w11) -> (reversed array=w12)
  $"appended array" <- w12
