vi "Create Phase Errors.gvi"   [LabVIEW NXG 2.1.0]
# Calculates the RF signal power on primary and secondary channels. Compares the RF signal power against CCA energy threshold and generated CCA indication based on energy detection.
# Latency: min 10 clock cycles
inputs:
  "FPGA interface": "802.11 FGPA Reference.gtype"  # Interface to the device's FPGA handle.
  "error in": error
outputs:
  "error out": error
  "FPGA interface dup": "802.11 FGPA Reference.gtype"  # Interface to the device's FPGA handle.
  "buffer full": bool  # Indicates that the payload was not forwarded to TX Data DMA FIFO because the FIFO was full.
  "randomization index payload": u8[]
  "empty elements remaining": u32
panel controls:
  "Check Box": bool = TRUE
  "message": u8[114] = [0, 0, 0, 0, 0, 64, 0, 64, 0, 192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]
  "message complex": "message_all_SC_1.gtype" = [1+0i, 1+0i, 1+0i, 1+0i, 1+0i, 1+0i, 1+0i, 1+0i, 1+0i, 1+0i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]
panel indicators:
  "Array": u8[114]
types:
  "message_all_SC_1.gtype" = CFXP(2.14)[57]
uses:
  NI::G Core::Error::Filter Error Code.gvi
diagram:
  case ($"Check Box") {
    frame False, Default {
      w1 = $"error in"
      w2 = $"FPGA interface"
      w3 = 0
      w4 = u8[] []
    }
    frame True {
      # Implementation note: Sequence number generator is missing here. Reusing MAC sequence number for  PoC
      Property Node(instance in=$"FPGA interface") -> ("sequence number send"=w5)
      call "AnBa Convert Complex Array to Unsigned Array.gvi"(message complex=$"message complex", sequence number=w5) -> (Array=w6)
      $Array <- w6
      call "802.11 Encode ICP.gvi"(message=w6, payload=[0]) -> (ICP message=w7)
      Host Fifo Write Node[FifoName="802.11 AFW Resources.grsc\\H2T Channel Distrubance"](data=w7, error in=$"error in", reference in=$"FPGA interface", timeout (ms)=0) -> (empty elements remaining=w3, error out=w1, reference out=w2)
      call "Convert Int to Uint8 Array.gvi"(sequence number send=w5) -> (appended array=w4)
    }
  }
  $"FPGA interface dup" <- w2
  $"empty elements remaining" <- w3
  call "Filter Error Code.gvi"(Fehler (Eingang)=w1, Zu löschender Code=-50400) -> (Fehler (Ausgang)=w8, Fehler gelöscht?=w9)
  $"error out" <- w8
  $"buffer full" <- w9
  $"randomization index payload" <- w4
