vi "Get 20MHz SCs.gvi"   [LabVIEW NXG 2.1.0]
inputs:
  "Delete DC": bool
  "array": f64[]
outputs:
  "SCs": f64[]
diagram:
  Array Subset(array=$array, index0=64, length0=53) -> w1
  case ($"Delete DC") {
    frame False, Default {
      w2 = w1
    }
    frame True {
      Delete From Array(inArray=w1, index0=26) -> w2
    }
  }
  $SCs <- w2
