vi "RT ident of Rogue.gvi"   [LabVIEW NXG 2.1.0]
inputs:
  "Phase in": f64[]
outputs:
  "Phase Gradients": f64[]
  "Phase unwrapped": f64[]
  "Valid": bool
  "Merged Phases": f64[]
panel controls:
  "Take Measurements": bool
  "Measurement Ammount": i32 = 100
panel indicators:
  "Unmodified Phase": f64[]
  "Phase Errors lambda +26": f64[]
  "Measured Phases Unwrapped": f64[][]
  "Phase Errors lambda -26": f64[]
uses:
  NI::Analysis::LinearAlgebra::A x Vector.gvi
diagram:
  Array Size(array=$"Phase in") -> (size(s)=w1)
  w2 = [[-1, 1, 0, 0, 0, 0, 0, 0, 0, 0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], [0, -1, 1, 0, 0, 0, 0, 0, 0, 0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], [0, 0, -1, 1, 0, 0, 0, 0, 0, 0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], [0, 0, 0, -1, 1, 0, 0, 0, 0, 0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], [0, 0, 0, 0, -1, 1, 0, 0, 0, 0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], [0, 0, 0, 0, 0, -1, 1, 0, 0, 0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], [0, 0, 0, 0, 0, 0, -1, 1, 0, 0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], [0, 0, 0, 0, 0, 0, 0, -1, 1, 0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], [0, 0, 0, 0, 0, 0, 0, 0, -1, 1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], [0, 0, 0, 0, 0, 0, 0, 0, 0, -1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]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]
  call "A x Vector.gvi"(Matrix A=w2, Vektor v=$"Phase in") -> (A x v=w3)
  # Check if measurement is valid
  #
  # ==> Exclude Measurements where phase jumps more than pi but less then 2 pi
  s1 = 0  # shift register
  s2 = $"Phase in"  # shift register
  for (N = w1) (iteration -> i1) {
    w4 = each element of w3
    Is Less(x=w4, y=6) -> w5
    Is Greater(x=w4, y=3) -> w6
    Logical And(w5, w6) -> w7
    Not(x=w5) -> w8
    case (w8) {
      frame False, Default {
        w9 = s1
      }
      frame True {
        # shifted by 2 pi
        Increment(x=s1) -> w9
      }
    }
    Is Greater Than 0(x=s1) -> w10
    case (w10) {
      frame False, Default {
        w11 = s2
      }
      frame True {
        call "Add 2pi to Index.gvi"(array=s2, index=i1) -> (output array=w11)
      }
    }
    next s1 = w9
    next s2 = w11
    stop if w7
  }
  Is Greater Than 0(x=s1) -> w12
  # Valid phases not normalized
  case (w12) {
    frame False, Default {
      w13 = s2
    }
    frame True {
      call "Add 2pi to Index.gvi"(array=s2, index=51) -> (output array=w13)
    }
  }
  Not(x=w7) -> w14
  Logical And($"Take Measurements", w14) -> w15
  case (w15) {
    frame False, Default { }
    frame True {
      Delete From Array(inArray=$"Measured Phases Unwrapped", index0=$"Measurement Ammount") -> w16
      Insert Into Array(inArray=w16, index0=0, new=w13) -> w17
      Feedback Node(input=w17) -> w18
      $"Measured Phases Unwrapped" <- w18
    }
  }
  # +1
  Array Index(array=w13) -> (out0[26]=w19)
  # -1
  Array Index(array=w13) -> (out0[25]=w20)
  Add(w19, w20) -> w21
  Divide(x=w21, y=2) -> w22
  Subtract(x=w13, y=w22) -> w23
  # unwrapped and normalized phases
  $"Phase unwrapped" <- w23
  # Compensate for the last index
  $Valid <- w14
  w24 = [-26, -25, -24, -23, -22, -21, -20, -19, -18, -17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]
  Array Index(array=w13) -> (out0[51]=w25)
  Subtract(x=w25, y=w22) -> w26
  Negate(x=-52) -> w27
  # Z*
  Multiply(w27, f64 default) -> w28
  Divide(x=1, y=w28) -> w29
  # lambda +26
  Multiply(w26, w29) -> w30
  # lambda +26
  # Z*
  case (w14) {
    frame False, Default {
      w31 = w13
    }
    frame True {
      Multiply(w30, f64 default) -> w32
      Multiply(w24, w32) -> w33
      Add(w22, w33) -> w34
      Subtract(x=w13, y=w34) -> w31
    }
  }
  # and seconds 26 values from lambda +26
  $"Phase Errors lambda +26" <- w31
  $"Phase Gradients" <- w3
  # Extract Phase Gradients
  $"Unmodified Phase" <- $"Phase in"
  Multiply(-52, f64 default) -> w35
  Divide(x=1, y=w35) -> w36
  # -28
  Array Index(array=w13) -> (out0[0]=w37)
  Subtract(x=w37, y=w22) -> w38
  # lambda -26
  Multiply(w38, w36) -> w39
  # lambda -26
  # Z*
  # get the first 26 values from lambda -26
  case (w14) {
    frame False, Default {
      w40 = w13
    }
    frame True {
      Multiply(w39, f64 default) -> w41
      Multiply(w24, w41) -> w42
      Add(w22, w42) -> w43
      Subtract(x=w13, y=w43) -> w40
    }
  }
  $"Phase Errors lambda -26" <- w40
  Array Subset(array=w31, index0=26, length0=26) -> w44
  Array Subset(array=w40, length0=26) -> w45
  Build Array[ConcatenateInputs=True](w45, w44) -> w46
  $"Merged Phases" <- w46
