vi "Randomize Fingerprint.gvi"   [LabVIEW NXG 2.1.0]
inputs:
  "theta": FXP(4.13)
  "selector": bool
  "index": i32
outputs:
  "theta out": FXP(4.13)
panel controls:
  "variance": f64 = 0.1
uses:
  NI::Analysis::Generation::Gaussian White Noise.gvi
  NI::Analysis::Generation::Triangle Wave.gvi
  NI::Analysis::Generation::Sine Wave.gvi
diagram:
  # var
  Multiply($variance, 12) -> w1
  Square Root(x=w1) -> w2
  Divide(x=w2, y=2) -> w3
  Random Number() -> (number (0 to 1)=w4)
  Multiply(2, w4) -> w5
  # uniform distribution
  Subtract(x=w5, y=1) -> w6
  Multiply(w3, w6)
  # var
  Square Root(x=$variance) -> w7
  # spoof fingerprint with custom shape
  call "Gaussian White Noise.gvi"(Samples=1, Standardabweichung=w7) -> (Gaußsches weißes Rauschen=w8)
  # gaussian distribution
  Array Index(array=w8)
  call "Triangle Wave.gvi"(Sample-Rate=1, Samples=57, Amplitude=0.6, Frequenz=0.0078125, Phase zurücksetzen=TRUE) -> (Dreieckschwingung=w9)
  Array Index(array=w9)
  Random Number() -> (number (0 to 1)=w10)
  Subtract(x=w10, y=0.5) -> w11
  # laplacian distribution
  Sign(number=w11) -> (-1, 0, 1=w12)
  Absolute Value(x=w11) -> w13
  Multiply(2, w13) -> w14
  Subtract(x=1, y=w14) -> w15
  Natural Logarithm(x=w15) -> w16
  # var
  Divide(x=$variance, y=2) -> w17
  Square Root(x=w17) -> w18
  Multiply(w12, w16, w18) -> w19
  Subtract(x=0, y=w19)
  # mean-shift-uniform
  w20 = [0.234621662644, -0.0135489724763, -0.0747142157804, -0.277226113363, 0.194193697985, 0.276533945432, 0.0577493646444, -0.325420353467, -0.294278433933, 0.230176870622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]
  Array Index(array=w20) -> (out0[$index]=w21)
  Multiply($variance, 18) -> w22
  Divide(x=w22, y=3) -> w23
  Square Root(x=w23) -> w24
  # triangular
  Random Number() -> (number (0 to 1)=w25)
  Subtract(x=w25, y=0.5) -> w26
  Multiply(w26, w24) -> w27
  Random Number() -> (number (0 to 1)=w28)
  Subtract(x=w28, y=0.5) -> w29
  Multiply(w29, w24) -> w30
  Add(w27, w30) -> w31
  Add(w21, w31) -> w32
  To Fixed Point(number=w32) -> w33: FXP(4.14) Saturate:ConvergentRounding
  Add($theta, w33) -> w34: FXP(4.13) Saturate:ConvergentRounding
  Select(s=$selector, t=w34, f=$theta) -> w35
  $"theta out" <- w35
  # sine wive
  call "Sine Wave.gvi"(Sample-Rate=1, Samples=57, Amplitude=0.5, Frequenz=0.018, Phase zurücksetzen=TRUE)
  # var
