vi "Secure Fingerprinting Sender.gvi"   [LabVIEW NXG 2.1.0]
inputs:
  "theta in": FXP(4.13)
  "Boolean": bool
  "MAC seq num send": UFXP(12.0)
  "index": i32
outputs:
  "output": FXP(4.13)
panel indicators:
  "output_2": T1
types:
  T1 = enum{"pattern_1", "pattern_2", "pattern_3", "pattern_4"}
diagram:
  call "Determine Pattern.gvi"(MAC seq num send=$"MAC seq num send") -> (output_2=w1)
  $output_2 <- w1
  case (w1) {
    frame "pattern_1", Default {
      w3 = [0.0868761280556, 0.00517837757707, 0.302150673216, -0.213815228185, -0.190417096357, 0.183136988396, 0.344653423661, -0.333975665406, 0.166867033309, -0.338678367504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]
      w2 = w3
    }
    frame "pattern_2" {
      w4 = [-0.15477000681, -0.00237195766213, -0.00213530410186, -0.182561801509, 0.0325922344184, -0.119407104621, -0.106196406532, 0.0443096455506, 0.0943200191606, 0.338622289742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]
      w2 = w4
    }
    frame "pattern_3" {
      w5 = [0.0400846493985, 0.22886343544, 0.275342527497, 0.0298065354039, 0.0691406103989, -0.218090980375, 0.0529792292193, 0.102278710271, 0.194884446437, -0.246940453387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]
      w2 = w5
    }
    frame "pattern_4" {
      w6 = [-0.150922727578, 0.263700830335, -0.00015031957211, 0.289331046053, -0.0522990068288, 0.284084293415, 0.00423112053843, 0.325113636296, 0.238732985711, 0.104101632272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]
      w2 = w6
    }
  }
  Array Index(array=w2) -> (out0[$index]=w7)
  To Fixed Point(number=w7) -> w8: FXP(4.13) Saturate:ConvergentRounding
  Add($"theta in", w8) -> w9: FXP(4.13) Saturate:ConvergentRounding
  Select(s=$Boolean, t=w9, f=$"theta in") -> w10
  $output <- w10
