vi "Subtract Phase.gvi"   [LabVIEW NXG 2.1.0]
inputs:
  "theta": FXP(4.13)
  "theta new": FXP(4.13)
  "selector": bool
outputs:
  "output": FXP(4.13)
diagram:
  Subtract(x=$theta, y=$"theta new") -> w1: FXP(4.13) Saturate:ConvergentRounding
  Select(s=$selector, t=w1, f=$theta) -> w2
  $output <- w2
